# Grasshopper definition spiraling_camera_path.gh (Grasshopper 1.0.8)
# plug-ins: LunchBox

scan_centroid = GetPoint("0.5,0.6,0", AtLeast=1, AtMost=1, Realtime=True, TreeAccess=False)
scan_xyscale = GetNumber(Slider(0.25, range=0..1), AtLeast=1, AtMost=1, Maximum=1.797693135e+308, Minimum=-1.797693135e+308, TreeAccess=False)
scan_zscale = GetNumber(Slider(0.2, range=0..1), AtLeast=1, AtMost=1, Maximum=1.797693135e+308, Minimum=-1.797693135e+308, TreeAccess=False)

unit_z = UnitZ(Factor=scan_zscale)
center_box = CenterBox(Base=scan_centroid, X=scan_xyscale, Y=scan_xyscale, Z=scan_zscale)
move = Move(Geometry=center_box, Motion=unit_z)  # -> Geometry, Transform
bounding_box = BoundingBox(Content=move.Geometry, Plane=PlaneXY(0, 0, 0))  # -> Box, Box_2
deconstruct_brep = DeconstructBrep(Brep=bounding_box.Box)  # -> Faces, Edges, Vertices
area = Area(Geometry=deconstruct_brep.Faces)  # -> Area, Centroid
deconstruct = Deconstruct(Point=area.Centroid)  # -> XComponent, YComponent, ZComponent
sort_list = SortList(Keys=deconstruct.ZComponent, ValuesValuesA=deconstruct_brep.Faces, ValuesA=area.Centroid)  # -> Keys, reverse(ValuesValuesA), reverse(ValuesA)
list_item = ListItem(List=sort_list.ValuesValuesA, Index=0, Wrap=True)
deconstruct_brep_2 = DeconstructBrep(Brep=list_item)  # -> Faces, Edges, Vertices
length = Length(Curve=deconstruct_brep_2.Edges)
sort_list_2 = SortList(Keys=length, ValuesValuesA=deconstruct_brep_2.Edges)  # -> reverse(Keys), ValuesValuesA
dispatch = Dispatch(List=sort_list_2.ValuesValuesA, DispatchPattern=[True, False])  # -> ListA, ListB
list_item_2 = ListItem(List=dispatch.ListA, Index=0, Wrap=True)  # -> Item, Item1
list_item_3 = ListItem(List=dispatch.ListB, Index=0, Wrap=True)  # -> Item, Item1
number_slider = Slider(9, range=1..101)
number_slider_2 = Slider(9, range=1..101)
scan_height = GetNumber(Slider(0.28, range=0..1), AtLeast=1, AtMost=1, Maximum=1.797693135e+308, Minimum=-1.797693135e+308, TreeAccess=False)
divide_curve = DivideCurve(Curve=list_item_3.Item, Count=number_slider, Kinks=False)  # -> Points, Tangents, Parameters
divide_curve_2 = DivideCurve(Curve=list_item_2.Item, Count=number_slider_2, Kinks=False)  # -> Points, Tangents, Parameters
divide_curve_3 = DivideCurve(Curve=list_item_3.Item1, Count=number_slider, Kinks=False)  # -> Points, Tangents, Parameters
divide_curve_4 = DivideCurve(Curve=list_item_2.Item1, Count=number_slider_2, Kinks=False)  # -> Points, Tangents, Parameters
line = Line(StartPoint=divide_curve.Points, EndPoint=reverse(divide_curve_3.Points))
line_2 = Line(StartPoint=divide_curve_2.Points, EndPoint=reverse(divide_curve_4.Points))
unit_z_2 = UnitZ(Factor=scan_height)
unit_z_3 = UnitZ(Factor=scan_height)
curve_middle = CurveMiddle(Curve=line)
curve_middle_2 = CurveMiddle(Curve=line_2)
move_2 = Move(Geometry=curve_middle, Motion=unit_z_2)  # -> reverse(Geometry), Transform
move_3 = Move(Geometry=curve_middle_2, Motion=unit_z_3)  # -> reverse(Geometry), Transform
shift_list = ShiftList(List=divide_curve.Points, Shift=Slider(-1, range=-10..0), Wrap=True)
shift_list_2 = ShiftList(List=divide_curve_2.Points, Shift=Slider(-1, range=-10..0), Wrap=True)
list_item_4 = ListItem(List=reverse(divide_curve.Points), Index=0, Wrap=True)
panel = Panel("""0
0
1""")
list_item_5 = ListItem(List=reverse(divide_curve_2.Points), Index=0, Wrap=True)
panel_2 = Panel("""0
0
1""")
panel_3 = Panel("""1
0
0""")
panel_4 = Panel("""1
0
0""")
panel_5 = Panel("""0
0
1""")
panel_6 = Panel("""0
0
1""")
panel_7 = Panel("""0
1
0""")
panel_8 = Panel("""0
1
0""")
panel_9 = Panel("""0
0
1""")
panel_10 = Panel("""0
0
1""")
panel_11 = Panel("""0
0
1""")
panel_12 = Panel("""0
0
1""")
cull_pattern = CullPattern(List=reverse(divide_curve.Points), CullPattern=panel_3)
cull_pattern_2 = CullPattern(List=reverse(divide_curve_2.Points), CullPattern=panel_4)
cull_pattern_3 = CullPattern(List=reverse(shift_list), CullPattern=panel_5)
cull_pattern_4 = CullPattern(List=reverse(shift_list_2), CullPattern=panel_6)
cull_pattern_5 = CullPattern(List=divide_curve_3.Points, CullPattern=panel)
cull_pattern_6 = CullPattern(List=divide_curve_4.Points, CullPattern=panel_2)
cull_pattern_7 = CullPattern(List=divide_curve_3.Points, CullPattern=panel_9)
cull_pattern_8 = CullPattern(List=divide_curve_4.Points, CullPattern=panel_11)
cull_pattern_9 = CullPattern(List=move_2.Geometry, CullPattern=panel_7)
cull_pattern_10 = CullPattern(List=move_3.Geometry, CullPattern=panel_8)
cull_pattern_11 = CullPattern(List=move_2.Geometry, CullPattern=panel_10)
cull_pattern_12 = CullPattern(List=move_3.Geometry, CullPattern=panel_12)
entwine = Entwine(Branch00=cull_pattern_5, Branch01=cull_pattern_11, Branch02=cull_pattern_3, FlattenInputs=True)
entwine_2 = Entwine(Branch00=cull_pattern_6, Branch01=cull_pattern_12, Branch02=cull_pattern_4, FlattenInputs=True)
entwine_3 = Entwine(Branch00=cull_pattern, Branch01=cull_pattern_9, Branch02=cull_pattern_7, FlattenInputs=True)
entwine_4 = Entwine(Branch00=cull_pattern_2, Branch01=cull_pattern_10, Branch02=cull_pattern_8, FlattenInputs=True)
flip_matrix = FlipMatrix(Data=entwine)
flip_matrix_2 = FlipMatrix(Data=entwine_2)
flip_matrix_3 = FlipMatrix(Data=entwine_3)
flip_matrix_4 = FlipMatrix(Data=entwine_4)
interpolate = Interpolate(Vertices=flip_matrix, Degree=3, Periodic=False, KnotStyle=1)  # -> Curve, Length, Domain
interpolate_2 = Interpolate(Vertices=flip_matrix_2, Degree=3, Periodic=False, KnotStyle=1)  # -> Curve, Length, Domain
interpolate_3 = Interpolate(Vertices=flip_matrix_3, Degree=3, Periodic=False, KnotStyle=1)  # -> flatten(Curve), Length, Domain
interpolate_4 = Interpolate(Vertices=flip_matrix_4, Degree=3, Periodic=False, KnotStyle=1)  # -> flatten(Curve), Length, Domain
cull_index = CullIndex(List=flatten(interpolate.Curve), Indices="-1", Wrap=True)
cull_index_2 = CullIndex(List=flatten(interpolate_2.Curve), Indices="-1", Wrap=True)
join_curves = JoinCurves(Curves=flatten([interpolate_3.Curve, cull_index]), Preserve=False)
join_curves_2 = JoinCurves(Curves=flatten([interpolate_4.Curve, cull_index_2]), Preserve=False)
polyline = PolyLine(Vertices=curve_middle, Closed=False)
polyline_2 = PolyLine(Vertices=curve_middle_2, Closed=False)
list_item_6 = ListItem(List=sort_list.ValuesValuesA, Index=0, Wrap=True)  # -> Item1, Item
list_item_7 = ListItem(List=sort_list.ValuesValuesA, Index=0, Wrap=True)  # -> Item1, Item
divide_curve_5 = DivideCurve(Curve=join_curves, Count=Slider(75, range=0..100), Kinks=False)  # -> Points, Tangents, Parameters
divide_curve_6 = DivideCurve(Curve=join_curves_2, Count=Slider(75, range=0..100), Kinks=False)  # -> Points, Tangents, Parameters
project = Project(Geometry=polyline, Plane=list_item_6.Item1)  # -> Geometry, Transform
project_2 = Project(Geometry=polyline_2, Plane=list_item_7.Item1)  # -> Geometry, Transform
curve_closest_point = CurveClosestPoint(Point=divide_curve_5.Points, Curve=project.Geometry)  # -> Point, Parameter, Distance
curve_closest_point_2 = CurveClosestPoint(Point=divide_curve_6.Points, Curve=project_2.Geometry)  # -> Point, Parameter, Distance
vector_2pt = Vector2Pt(PointA=divide_curve_5.Points, PointB=curve_closest_point.Point, Unitize=False)  # -> Vector, Length
vector_2pt_2 = Vector2Pt(PointA=divide_curve_6.Points, PointB=curve_closest_point_2.Point, Unitize=False)  # -> Vector, Length
construct_plane = ConstructPlane(Origin=divide_curve_5.Points, XAxis=Vector(1, 0, 0), YAxis=Vector(0, 1, 0))
construct_plane_2 = ConstructPlane(Origin=divide_curve_6.Points, XAxis=Vector(1, 0, 0), YAxis=Vector(0, 1, 0))
adjust_plane = AdjustPlane(Plane=construct_plane, Normal=vector_2pt.Vector)
adjust_plane_2 = AdjustPlane(Plane=construct_plane_2, Normal=vector_2pt_2.Vector)

scan1_reversexaxis = GetBoolean(Toggle(False), AtLeast=1, AtMost=1, FalseValue="False", TreeAccess=False, TrueValue="True")
scan1_reverseyaxis = GetBoolean(Toggle(False), AtLeast=1, AtMost=1, FalseValue="False", TreeAccess=False, TrueValue="True")
scan1_swapaxis = GetBoolean(Toggle(False), AtLeast=1, AtMost=1, FalseValue="False", TreeAccess=False, TrueValue="True")

scan2_reversexaxis = GetBoolean(Toggle(False), AtLeast=1, AtMost=1, FalseValue="False", TreeAccess=False, TrueValue="True")
scan2_reverseyaxis = GetBoolean(Toggle(False), AtLeast=1, AtMost=1, FalseValue="False", TreeAccess=False, TrueValue="True")
scan2_swapaxis = GetBoolean(Toggle(False), AtLeast=1, AtMost=1, FalseValue="False", TreeAccess=False, TrueValue="True")

flip_plane = FlipPlane(Plane=adjust_plane, ReverseX=scan2_reversexaxis, ReverseY=scan2_reverseyaxis, SwapAxes=scan2_swapaxis)
flip_plane_2 = FlipPlane(Plane=adjust_plane_2, ReverseX=scan1_reversexaxis, ReverseY=scan1_reverseyaxis, SwapAxes=scan1_swapaxis)
deconstruct_plane = DeconstructPlane(Plane=flip_plane)  # -> Origin, XAxis, YAxis, ZAxis
deconstruct_plane_2 = DeconstructPlane(Plane=flip_plane_2)  # -> Origin, XAxis, YAxis, ZAxis
entwine_5 = Entwine(
    Branch00=deconstruct_plane.Origin,
    Branch01=deconstruct_plane.XAxis,
    Branch02=deconstruct_plane.YAxis,
    FlattenInputs=True)
entwine_6 = Entwine(
    Branch00=deconstruct_plane_2.Origin,
    Branch01=deconstruct_plane_2.XAxis,
    Branch02=deconstruct_plane_2.YAxis,
    FlattenInputs=True)
panel_13 = Panel("""point
x-axis
y-axis""")
filename = Data("Planes")
panel_14 = Panel("""point
x-axis
y-axis""")
create_datatable = CreateDataTable(TableName=filename, TableHeaders=panel_13, ValueTree=entwine_6)
filename_2 = Data("Planes")
create_datatable_2 = CreateDataTable(TableName=filename_2, TableHeaders=panel_14, ValueTree=entwine_5)
create_dataset = CreateDataSet(DataSetName=filename, DataTables=create_datatable)
panel_15 = Panel("C:\Users\Lennart Hamm\Desktop\TU Wien\LABOR\Forschungsfelder\Data Interpolation\TargetPlanes.json")
create_dataset_2 = CreateDataSet(DataSetName=filename_2, DataTables=create_datatable_2)
panel_16 = Panel("C:\Users\Lennart Hamm\Desktop\TU Wien\LABOR\Forschungsfelder\Data Interpolation\TargetPlanes2.json")
create_json = CreateJSON(WriteJSON=Toggle(False), DataSet=create_dataset)
create_json_2 = CreateJSON(WriteJSON=Toggle(False), DataSet=create_dataset_2)
targetplanes = Panel(create_json)

scan1_jsonpath = GetString(panel_15, AtLeast=1, AtMost=1, TreeAccess=False)
scan1_jsondump = GetBoolean(Toggle(True), AtLeast=1, AtMost=1, FalseValue="False", TreeAccess=False, TrueValue="True")

targetplanes_2 = Panel(create_json_2)

scan2_jsonpath = GetString(panel_16, AtLeast=1, AtMost=1, TreeAccess=False)
scan2_jsondump = GetBoolean(Toggle(True), AtLeast=1, AtMost=1, FalseValue="False", TreeAccess=False, TrueValue="True")

context_print = ContextPrint(Text=create_json_2)
python_3_script = Python3Script(Dump=scan1_jsondump, path=scan1_jsonpath, data=targetplanes)  # -> out, a
# ---------- python_3_script: Python ----------
#print json files to defined locations. Author: lennox

import json

parsed_data = json.loads(data)

fields_to_convert = ["point", "x-axis", "y-axis"]

for item in parsed_data["Planes"]:
    for key in fields_to_convert:
        if key in item:
            raw_str = item[key].strip("{}")
            coords = [float(c.strip()) for c in raw_str.split(",")]
            item[key] = coords


ghObjects = {"TargetPlanes": parsed_data}

with open(path, "w") as outfile:
    json.dump(ghObjects, outfile, indent=4)
# ---------- end python_3_script ----------
python_3_script_2 = Python3Script(Dump=scan2_jsondump, path=scan2_jsonpath, data=targetplanes_2)  # -> out, a; same code as python_3_script
