# Grasshopper definition json_to_gh_mesh.gh (Grasshopper 1.0.8)
# plug-ins: MeshEdit Components, Pufferfish

py3 = Python3Script()  # -> m
# ---------- py3: Python ----------
#! python3
import compas
from compas.datastructures import Mesh
from compas_rhino.conversions import mesh_to_rhino

raw = compas.data.json_load("C:\\Users\\michi\\Documents\\WORK\\TUrobo\\scripts\\filesrhinotocompas\\wallsmall_not_overlapping.json")

rhinomeshes = []
for mesh in raw:
    rhinomeshes.append(mesh_to_rhino(mesh))

m = rhinomeshes
# ---------- end py3 ----------
data = Data(py3)
rebmsh = RebuildMesh(
    Mesh=data,
    RebuildNormals=False,
    CullUnused=invert(False),
    UnifyNormals=invert(False),
    FlipNormals=False,
    IdenticalCombine=invert(False),
    WeldVertices="0.01")
weldvertices = MeshWeldVertices(Mesh=data, Tolerance=0.01)  # -> RuntimeMessage, Mesh
weld = WeldMesh(Mesh=data, Angle=3.141592654)
